# Grasshopper definition Concrete Slab.gh (Grasshopper 1.0.8)

_24 = Number(24)
_2 = Number(2)
_5 = Number(5)
py3 = Python3Script(Length=_24, Width=_24, Depth=_24, Cover=_2, Diameter=_5, Spacing=_5)  # -> out, Rebar, Slab
# ---------- py3: Python ----------
"""
Generates a top and bottom mat of rebar for a concrete slab.

To use:
1. Create a GHPython component.
2. Zoom in and add the following inputs:
    - Length (Type Hint: float)
    - Width (Type Hint: float)
    - Depth (Type Hint: float) - This is the slab thickness.
    - Cover (Type Hint: float) - Concrete cover from edge.
    - Diameter (Type Hint: float) - Rebar diameter.
    - Spacing (Type Hint: float) - Center-to-center spacing of bars.
3. Add the following outputs:
    - Rebar (Type Hint: Curve)
    - Slab (Type Hint: Box)
4. Copy and paste this code into the component.
5. Connect Number Sliders to the inputs.
"""

import Rhino.Geometry as rg

# --- 1. Initialize Outputs ---
# Create an empty list to hold all our rebar curves
rebar_curves = []

# --- 2. Input Validation ---
# Check if all inputs are connected and valid
if not all([Length, Width, Depth, Cover, Diameter, Spacing]):
    print("Error: Please connect all inputs.")
    Rebar = []
    Slab = None
else:
    
    # --- 3. Define Parameters & Z-Levels ---
    
    # Assign inputs to clear variable names
    L = Length  # Along X-axis
    W = Width   # Along Y-axis
    H = Depth   # Along Z-axis (slab thickness)
    
    half_d = Diameter / 2.0
    
    # Check if the slab is thick enough for the rebar
    # We need: TopCover + TopYBar + TopXBar + BottomXBar + BottomYBar + BottomCover
    # Simplified: 2*Cover + 4*Diameter
    min_thickness = (2 * Cover) + (4 * Diameter)
    
    if H < min_thickness:
        print("Error: Slab Depth is too thin for two stacked rebar layers with this cover and diameter.")
        Rebar = []
        Slab = None
    else:
        
        # --- 4. Define Boundaries for Rebar Centerlines ---
        
        # The rebar grid is inset from the slab edge by the
        # cover distance + half the rebar diameter.
        
        # X-coordinates for bar centerlines
        x_min = Cover + half_d
        x_max = L - (Cover + half_d)
        
        # Y-coordinates for bar centerlines
        y_min = Cover + half_d
        y_max = W - (Cover + half_d)
        
        # Z-coordinates for centerlines, accounting for stacking
        # Bottom Mat
        z_bot_y = Cover + half_d                  # Layer 1 (Bottom, Y-dir)
        z_bot_x = Cover + half_d + Diameter       # Layer 2 (Bottom, X-dir)
        
        # Top Mat
        z_top_x = H - (Cover + half_d + Diameter) # Layer 3 (Top, X-dir)
        z_top_y = H - (Cover + half_d)            # Layer 4 (Top, Y-dir)

        # --- 5. Generate Rebar Geometry ---
        
        # Use a small tolerance for float comparison
        tol = 1e-9

        # --- Bottom Mat: Y-Direction Bars (Layer 1) ---
        current_x = x_min
        while current_x <= x_max + tol:
            p1 = rg.Point3d(current_x, y_min, z_bot_y)
            p2 = rg.Point3d(current_x, y_max, z_bot_y)
            rebar_curves.append(rg.LineCurve(p1, p2))
            current_x += Spacing

        # --- Bottom Mat: X-Direction Bars (Layer 2) ---
        current_y = y_min
        while current_y <= y_max + tol:
            p1 = rg.Point3d(x_min, current_y, z_bot_x)
            p2 = rg.Point3d(x_max, current_y, z_bot_x)
            rebar_curves.append(rg.LineCurve(p1, p2))
            current_y += Spacing

        # --- Top Mat: X-Direction Bars (Layer 3) ---
        current_y = y_min
        while current_y <= y_max + tol:
            p1 = rg.Point3d(x_min, current_y, z_top_x)
            p2 = rg.Point3d(x_max, current_y, z_top_x)
            rebar_curves.append(rg.LineCurve(p1, p2))
            current_y += Spacing

        # --- Top Mat: Y-Direction Bars (Layer 4) ---
        current_x = x_min
        while current_x <= x_max + tol:
            p1 = rg.Point3d(current_x, y_min, z_top_y)
            p2 = rg.Point3d(current_x, y_max, z_top_y)
            rebar_curves.append(rg.LineCurve(p1, p2))
            current_x += Spacing

        # --- 6. Generate Context Slab Geometry ---
        # Create a box from (0,0,0) to (L,W,H)
        plane = rg.Plane.WorldXY
        x_interval = rg.Interval(0, L)
        y_interval = rg.Interval(0, W)
        z_interval = rg.Interval(0, H)
        
        slab_box = rg.Box(plane, x_interval, y_interval, z_interval)

        # --- 7. Assign to Outputs ---
        Rebar = rebar_curves
        Slab = slab_box
# ---------- end py3 ----------
