# Grasshopper definition ODOT - Steel Girder, Concrete Deck.gh (Grasshopper 1.0.8)

set_to_the_roadway_alignment = Curve(<curve referenced from the Rhino model>)
beamspacing = Number(5)
beamlines = Integer(7)
w36x150 = Text("W36X150")
extruderolledwbeams = Python3Script(
    beam_centerline=set_to_the_roadway_alignment,
    section_label=w36x150,
    number_of_beamlines=beamlines,
    beam_spacing=beamspacing)  # -> out, beams; inputs beam_centerline: Curve, number_of_beamlines: Int32
# ---------- extruderolledwbeams: Python ----------
import Rhino.Geometry as rg
import Rhino
import math
from civilpy.structural.steel import W

def get_unit_scale_factor():
    """
    Calculates the scale factor to convert inches (steel data source) 
    to the current Rhino document units.
    """
    # Rhino units: 1 = mm, 2 = cm, 3 = m, 4 = km, 8 = inches, 9 = feet...
    doc_units = Rhino.RhinoDoc.ActiveDoc.ModelUnitSystem
    # Convert 1 inch to current doc units
    return Rhino.RhinoMath.UnitScale(Rhino.UnitSystem.Inches, doc_units)

def get_sanitized_steel_data(section_label, scale_factor):
    """
    Retrieves section properties and scales them from inches 
    to the current document units.
    """
    try:
        profile = W(section_label)
        # Apply the scale factor to all linear dimensions
        data = {
            'd': float(profile.depth.magnitude) * scale_factor,
            'bf': float(profile.flange_width.magnitude) * scale_factor,
            'tw': float(profile.web_thickness.magnitude) * scale_factor,
            'tf': float(profile.flange_thickness.magnitude) * scale_factor,
            'k_design': float(profile.k_design.magnitude) * scale_factor
        }
        return data
    except Exception as e:
        print(f"Failed to get or sanitize data for {section_label}. Error: {e}")
        return None

def create_beam_geometry(data, beam_centerline):
    """
    Constructs the 3D beam Brep with true fillets using scaled dimensions.
    """
    d = data['d']
    bf = data['bf']
    tw = data['tw']
    tf = data['tf']
    k = data['k_design']
    
    half_bf = bf / 2.0
    half_tw = tw / 2.0
    # Calculate radius from k-dimension; ensure it's positive
    r = max(0.0001, k - tf)

    # Define profile points in a local XY plane (to be transformed later)
    p_bot_L = rg.Point3d(-half_bf, 0, 0)
    p_bot_R = rg.Point3d(half_bf, 0, 0)
    p_bot_inner_flange_R = rg.Point3d(half_bf, tf, 0)
    p_bot_fillet_end_R = rg.Point3d(half_tw + r, tf, 0)
    p_bot_fillet_start_R = rg.Point3d(half_tw, tf + r, 0)
    p_top_fillet_start_R = rg.Point3d(half_tw, d - tf - r, 0)
    p_top_fillet_end_R = rg.Point3d(half_tw + r, d - tf, 0)
    p_top_inner_flange_R = rg.Point3d(half_bf, d - tf, 0)
    p_top_R = rg.Point3d(half_bf, d, 0)
    p_top_L = rg.Point3d(-half_bf, d, 0)
    p_top_inner_flange_L = rg.Point3d(-half_bf, d - tf, 0)
    p_top_fillet_end_L = rg.Point3d(-(half_tw + r), d - tf, 0)
    p_top_fillet_start_L = rg.Point3d(-half_tw, d - tf - r, 0)
    p_bot_fillet_start_L = rg.Point3d(-half_tw, tf + r, 0)
    p_bot_fillet_end_L = rg.Point3d(-(half_tw + r), tf, 0)
    p_bot_inner_flange_L = rg.Point3d(-half_bf, tf, 0)
    
    segments = []
    # Top Flange
    segments.append(rg.LineCurve(p_top_L, p_top_R))
    segments.append(rg.LineCurve(p_top_R, p_top_inner_flange_R))
    segments.append(rg.LineCurve(p_top_inner_flange_R, p_top_fillet_end_R))
    
    # Fillet Top Right
    center_tr = rg.Point3d(half_tw + r, d - tf - r, 0)
    mid_tr = center_tr + rg.Vector3d(-r / math.sqrt(2), r / math.sqrt(2), 0)
    segments.append(rg.Arc(p_top_fillet_end_R, mid_tr, p_top_fillet_start_R).ToNurbsCurve())
    
    # Web Right
    segments.append(rg.LineCurve(p_top_fillet_start_R, p_bot_fillet_start_R))
    
    # Fillet Bottom Right
    center_br = rg.Point3d(half_tw + r, tf + r, 0)
    mid_br = center_br + rg.Vector3d(-r / math.sqrt(2), -r / math.sqrt(2), 0)
    segments.append(rg.Arc(p_bot_fillet_start_R, mid_br, p_bot_fillet_end_R).ToNurbsCurve())
    
    # Bottom Flange Right
    segments.append(rg.LineCurve(p_bot_fillet_end_R, p_bot_inner_flange_R))
    segments.append(rg.LineCurve(p_bot_inner_flange_R, p_bot_R))
    segments.append(rg.LineCurve(p_bot_R, p_bot_L))
    
    # Bottom Flange Left
    segments.append(rg.LineCurve(p_bot_L, p_bot_inner_flange_L))
    segments.append(rg.LineCurve(p_bot_inner_flange_L, p_bot_fillet_end_L))
    
    # Fillet Bottom Left
    center_bl = rg.Point3d(-(half_tw + r), tf + r, 0)
    mid_bl = center_bl + rg.Vector3d(r / math.sqrt(2), -r / math.sqrt(2), 0)
    segments.append(rg.Arc(p_bot_fillet_end_L, mid_bl, p_bot_fillet_start_L).ToNurbsCurve())
    
    # Web Left
    segments.append(rg.LineCurve(p_bot_fillet_start_L, p_top_fillet_start_L))
    
    # Fillet Top Left
    center_tl = rg.Point3d(-(half_tw + r), d - tf - r, 0)
    mid_tl = center_tl + rg.Vector3d(r / math.sqrt(2), r / math.sqrt(2), 0)
    segments.append(rg.Arc(p_top_fillet_start_L, mid_tl, p_top_fillet_end_L).ToNurbsCurve())
    
    # Top Flange Left
    segments.append(rg.LineCurve(p_top_fillet_end_L, p_top_inner_flange_L))
    segments.append(rg.LineCurve(p_top_inner_flange_L, p_top_L))
    
    # Join the curve
    tol = Rhino.RhinoDoc.ActiveDoc.ModelAbsoluteTolerance
    joined_curves = rg.Curve.JoinCurves(segments, tol, False)
    if not joined_curves or len(joined_curves) != 1:
        print("Failed to join profile segments.")
        return None
    profile_curve = joined_curves[0]
    
    # Orient the profile to the start of the beam centerline
    origin_plane = rg.Plane.WorldXY
    start_point = beam_centerline.PointAtStart
    tangent = beam_centerline.TangentAtStart
    world_up = rg.Vector3d(0, 0, 1)

    # Handle vertical beam cases
    if rg.Vector3d.IsParallelTo(tangent, world_up) != 0:
        plane_y_axis = rg.Vector3d.CrossProduct(tangent, rg.Vector3d(0, 1, 0))
        plane_x_axis = rg.Vector3d.CrossProduct(plane_y_axis, tangent)
    else:
        plane_x_axis = rg.Vector3d.CrossProduct(world_up, tangent)
        plane_y_axis = rg.Vector3d.CrossProduct(tangent, plane_x_axis)

    start_plane = rg.Plane(start_point, plane_x_axis, plane_y_axis)
    xform = rg.Transform.PlaneToPlane(origin_plane, start_plane)
    profile_curve.Transform(xform)

    # Create 3D geometry
    breps = rg.Brep.CreateFromSweep(beam_centerline, profile_curve, True, tol)
    
    if breps and len(breps) > 0:
        # Cap the ends to make it a solid
        return breps[0].CapPlanarHoles(tol)
    else:
        print("Sweep operation failed.")
        return None

# --- Main Script Execution ---
beams = [] 

# Ensure variables exist (Grasshopper inputs)
if 'beam_centerline' in globals() and 'section_label' in globals() and \
   'number_of_beamlines' in globals() and 'beam_spacing' in globals():
    
    # Step 1: Get scale factor (Inches -> Doc Units)
    scale_factor = get_unit_scale_factor()
    
    # Step 2: Get clean, scaled data
    steel_data = get_sanitized_steel_data(section_label, scale_factor)
    
    if steel_data:
        # Step 3: Calculate horizontal offset direction (perpendicular to path)
        line_vector = beam_centerline.PointAtEnd - beam_centerline.PointAtStart
        world_up = rg.Vector3d(0, 0, 1)
        offset_direction = rg.Vector3d.CrossProduct(line_vector, world_up)
        
        # If the path is vertical, cross product with Y instead
        if offset_direction.IsTiny():
            offset_direction = rg.Vector3d.CrossProduct(line_vector, rg.Vector3d(0, 1, 0))
            
        offset_direction.Unitize()
        
        # Step 4: Center the layout
        if number_of_beamlines > 1:
            total_width = (number_of_beamlines - 1) * beam_spacing
            start_offset_dist = -total_width / 2.0
        else:
            start_offset_dist = 0
        
        # Step 5: Generate beamlines
        for i in range(int(number_of_beamlines)):
            current_offset_dist = start_offset_dist + (i * beam_spacing)
            translation_vector = offset_direction * current_offset_dist
            
            offset_line = beam_centerline.DuplicateCurve()
            offset_line.Translate(translation_vector)
            
            new_beam = create_beam_geometry(steel_data, offset_line)
            if new_beam:
                beams.append(new_beam)
else:
    print("Please connect all inputs: beam_centerline, section_label, number_of_beamlines, beam_spacing")
# ---------- end extruderolledwbeams ----------
